# Grasshopper definition L2.gh (Grasshopper 1.0.8)

xy_plane = XYPlane(Origin=Point(0, 0, 0))

# ---- group: Object / Make Grid / Base Box
rectangle = Rectangle(Plane=PlaneXY(0, 0, 0), XSize=Slider(2.8, range=0..100), YSize=Slider(2.8, range=0..100), Radius=0)  # -> Rectangle, Length
box_rectangle = BoxRectangle(Rectangle=rectangle.Rectangle, Height=Slider(7, range=-100..100))

# ---- group: Object / Make Grid / Base Shape
polygon = Polygon(
    Plane=PlaneXY(0, 0, 0),
    Radius=Slider(2, range=0..100),
    Segments=Slider(6, range=0..100),
    FilletRadius=Slider(0.3, range=0..100))  # -> Polygon, Length

# ---- group: Object / Make Grid
number_slider = Slider(3, range=1..20)
number_slider_2 = Slider(3, range=1..20)
number_slider_3 = Slider(5, range=1..20)

# ----
plane_surface = PlaneSurface(Plane=xy_plane, XSize=Domain(-10, 10), YSize=Domain(-10, 10))

# ---- group: Object / Make Grid
multiplication = Multiplication(A=number_slider_2, B=number_slider)
rotate = Rotate(Geometry=polygon.Polygon, Angle=Slider(0.785, range=-3.142..3.142), Plane=PlaneXY(0, 0, 0))  # -> Geometry, Transform
box_array = BoxArray(Geometry=rotate.Geometry, Cell=box_rectangle, XCount=number_slider_2, YCount=number_slider, ZCount=number_slider_3)  # -> Geometry, Transform

# ----
scale = Scale(Geometry=plane_surface, Center=Point(0, 0, 0), Factor=Slider(3, range=0..100))  # -> Geometry, Transform
unit_z = UnitZ(Factor=Slider(5, range=0..100))
linear_array = LinearArray(Geometry=scale.Geometry, Direction=unit_z, Count=Slider(10, range=1..100))  # -> Geometry, Transform

# ---- group: Object / Rotate by layer
rotation = Slider(0.524, range=-3.142..3.142)
area = Area(Geometry=box_array.Geometry)  # -> Area, Centroid
unit_z_2 = UnitZ(Factor=1)
average = Average(Input=area.Centroid)
series = Series(Start=0, Step=rotation, Count=number_slider_3)
addition = Addition(A=average, B=unit_z_2)
series_2 = Series(Start=series, Step=0, Count=multiplication)  # -> flatten(Series)
line = Line(StartPoint=average, EndPoint=addition)
rotate_axis = RotateAxis(Geometry=box_array.Geometry, Angle=series_2, Axis=line)  # -> Geometry, Transform

# ---- group: Object
partition_list = PartitionList(List=rotate_axis.Geometry, Size=multiplication)

# ---- group: Object / Scale by Layer
scale_factor = Slider(1, range=-10..10)
area_2 = Area(Geometry=partition_list)  # -> Area, Centroid
series_3 = Series(Start=1, Step=scale_factor, Count=number_slider_3)
average_2 = Average(Input=area_2.Centroid)
series_4 = Series(Start=series_3, Step=0, Count=multiplication)
scale_2 = Scale(Geometry=partition_list, Center=average_2, Factor=series_4)  # -> Geometry, Transform

# ---- group: Object (continued)
flatten_tree = FlattenTree(Tree=scale_2.Geometry, Path="{0}")

# ---- group: Object / Loft
series_5 = Series(Start=0, Step=1, Count=multiplication)
series_6 = Series(Start=series_5, Step=multiplication, Count=number_slider_3)
list_item = ListItem(List=flatten_tree, Index=series_6, Wrap=True)
loft_options = LoftOptions(Closed=False, Adjust=False, Rebuild=0, Refit=0, Type=0)
loft = Loft(Curves=list_item, Options=loft_options)  # -> flatten(Loft)

# ----
brep_join = BrepJoin(Breps=loft)  # -> Breps, Closed

# ---- group: Object (continued)
cap_holes = CapHoles(Brep=brep_join.Breps)
solid_union = SolidUnion(Breps=cap_holes)

# ----
brep_brep = BrepBrep(BrepA=solid_union, BrepB=linear_array.Geometry)  # -> Curves, Points
flatten_tree_2 = FlattenTree(Tree=solid_union, Path="{0}")
flatten_tree_3 = FlattenTree(Tree=brep_brep.Curves, Path="{0}")
list_length = ListLength(List=flatten_tree_2)
list_length_2 = ListLength(List=flatten_tree_3)
division = Division(A=list_length_2, B=list_length)
trim_tree = TrimTree(Tree=brep_brep.Curves, Depth=1)
series_7 = Series(Start=0, Step=1, Count=division)
series_8 = Series(Start=series_7, Step=division, Count=list_length)
list_item_2 = ListItem(List=flatten_tree_3, Index=series_8, Wrap=True)
flatten_tree_4 = FlattenTree(Tree=list_item_2, Path="{0}")
partition_list_2 = PartitionList(List=flatten_tree_4, Size=list_length)
bounding_box = BoundingBox(Content=partition_list_2, Plane=PlaneXY(0, 0, 0), UnionBox=True)  # -> Box, Box_2
move_to_plane = MoveToPlane(Geometry=list_item_2, Plane=PlaneXY(0, 0, 0), Above=True, Below=True)  # -> Geometry, Transform
move_to_plane_2 = MoveToPlane(Geometry=bounding_box.Box, Plane=PlaneXY(0, 0, 0), Above=True, Below=True)  # -> Geometry, Transform
box_properties = BoxProperties(Box=bounding_box.Box)  # -> Center, flatten(Diagonal), Area, Volume, Degeneracy
deconstruct_vector = DeconstructVector(Vector=box_properties.Diagonal)  # -> XComponent, YComponent, ZComponent
shift_list = ShiftList(List=deconstruct_vector.XComponent, Shift=1, Wrap=False)
number = Number(flatten([Slider(0, range=0..100), shift_list]))
mass_addition = MassAddition(Input=number)  # -> Result, PartialResults
series_9 = Series(Start=mass_addition.PartialResults, Step=0, Count=list_length)
unit_x = UnitX(Factor=series_9)
move = Move(Geometry=move_to_plane_2.Geometry, Motion=unit_x)  # -> Geometry, Transform
move_2 = Move(Geometry=move_to_plane.Geometry, Motion=unit_x)  # -> Geometry, Transform
point = Point(unit_x)
